# Dynamo custom node Collector.ElementsInView.dyf (Dynamo 0.8.2.2392)
# category: SpringNodes.Revit.Collectors
# Selects all elements visible in the input view.

view_s = Input()  # "view(s)"
refresh = Input(refresh:bool = true)
python_script = Python(IN[0]=view_s, IN[1]=refresh)
# ---------- python_script.python (34 lines) ----------
#Copyright(c) 2015, Dimitar Venkov
# @5devene, dimitar.ven@gmail.com

import clr

clr.AddReference("RevitServices")
import RevitServices
from RevitServices.Persistence import DocumentManager

clr.AddReference("RevitAPI")
from Autodesk.Revit.DB import FilteredElementCollector

doc = DocumentManager.Instance.CurrentDBDocument

clr.AddReference("RevitNodes")
import Revit
clr.ImportExtensions(Revit.Elements)

def tolist(obj1):
	if hasattr(obj1,"__iter__"):
		return obj1
	else:
		return [obj1]

elements = []
views = UnwrapElement(tolist(IN[0]))
for v in views:
	view_el = FilteredElementCollector(doc, v.Id).WhereElementIsNotElementType().ToElements()
	view_el = [e.ToDSType(True) for e in view_el]
	elements.append(view_el)
if len(elements) == 1:
	OUT = view_el
else:
	OUT = elements
# ----------------------------------------
element_s = Output(python_script)  # "element(s)"
