# Dynamo custom node Collector.LinkedInstanceElements.dyf "Springs.Collector.LinkedInstanceElements" (Dynamo 1.3.1.1736)
# category: Springs.Revit.Collectors
# Extract elements by category from the selected linked instances. The transform CS can be used to get the exact location of the elements in the host file. If an error occurs or the linked document is unloaded, an error will be returned in the elements output and the appropriate transform will be a null. You can use those nulls to filter out the errors.

linkInstance = Input(linkInstance:var[])
category = Input(category:var)
refresh = Input(refresh:bool = true)
python_script = Python(IN[0]=linkInstance, IN[1]=category, IN[2]=refresh)
# ---------- python_script.python (39 lines) ----------
# Copyright(c) 2017, Dimitar Venkov
# @5devene, dimitar.ven@gmail.com
# www.badmonkeys.net

import clr

clr.AddReference("RevitNodes")
import Revit
clr.ImportExtensions(Revit.Elements)
clr.ImportExtensions(Revit.GeometryConversion)

clr.AddReference('RevitServices')
from RevitServices.Persistence import DocumentManager
doc = DocumentManager.Instance.CurrentDBDocument

clr.AddReference("RevitAPI")
from Autodesk.Revit.DB import FilteredElementCollector, RevitLinkType

def tolist(obj1):
	if hasattr(obj1,"__iter__"): return obj1
	else: return [obj1]

links = UnwrapElement(tolist(IN[0]) )
cat1 = UnwrapElement(IN[1])
elements, transforms = [], []
OUT = elements, transforms
for link in links:
	try:
		if RevitLinkType.IsLoaded(doc, link.GetTypeId() ):
			linkDoc = link.GetLinkDocument()
			fec = FilteredElementCollector(linkDoc).OfCategoryId(cat1.Id).WhereElementIsNotElementType()
			elements.append([e.ToDSType(True) for e in fec])
			transforms.append(link.GetTotalTransform().ToCoordinateSystem(True) )
		else:
			elements.append('Linked document is unloaded')
			transforms.append(None)
	except Exception, ex:
		elements.append(str(ex) )
		transforms.append(None)
# ----------------------------------------
code_block = CodeBlock(res=python_script) { res[0]; res[1]; }
elements = Output(code_block.out0)
transform = Output(code_block.out1)
