# Dynamo custom node Number.ToString.dyf (Dynamo 0.8.2.2392)
# category: SpringNodes.Core
# Converts the input number(s) to string. Can process lists.

num = Input()
python_script = Python(IN[0]=num)
# ---------- python_script.python (24 lines) ----------
#Copyright(c) 2015, Dimitar Venkov
# @5devene, dimitar.ven@gmail.com

import clr

def tolist(obj1):
	if hasattr(obj1,"__iter__"):
		return obj1
	else:
		return [obj1]

num1 = tolist(IN[0])
out1 = []
for n in num1:
	s1 = str(n)
	if s1[-2:] == ".0":
		out1.append(s1[:-2])
	else:
		out1.append(s1)

if len(out1) == 1 :
	OUT = out1[0]
else:
	OUT = out1
# ----------------------------------------
str = Output(python_script)
